# Grasshopper definition 2DMemberWithOpening.gh (Grasshopper 1.0.7)
# plug-ins: Koala

panel = Panel("""-1;-1
0;0
1;1""")
# Syntax for thickness:
# constant:
# constant|200
# variable:
# variable|Global X|200;N1|400;N2 - definition of the change of the thickness and then thickness on node1 and the node 2
# Posibilities:
# Global X
# Global Y
# Global Z
# Local X
# Local Y
# Variable in two directions
# Radial (circular slabs only)
# Variable in 4 pt.
panel_2 = Panel("constant|300")
nonlinearfunction = NonlinearFunction(Name="NFL1", Type=0, PositiveEnd=0, NegativeEnd=0, GrahpPoints=panel)
nonlinearfunction_2 = NonlinearFunction(Name="NFL2", Type=2, PositiveEnd=0, NegativeEnd=0, GrahpPoints=panel)
nonlinearfunction_3 = NonlinearFunction(Name="NLF1", Type=0, PositiveEnd=0, NegativeEnd=0, GrahpPoints="-1;0")
internal_nodes = Panel("S1|NSp1;NSp2;NSp3")
edgesupport = EdgeSupport(
    ListOfSurfaces_EdgesType="S1;SURFACE;1",
    Rx=2,
    Ry=2,
    Rz=2,
    Tx=2,
    Ty=2,
    Tz=7,
    StiffnessRx=10,
    StiffnessRy=20,
    StiffnessRz=30,
    StiffnessTx=40,
    StiffnessTy=50,
    StiffnessTz=60,
    CoordDefinition=0,
    Position1=0.25,
    Position2=0.5,
    Origin=0,
    FunctionTz="NFL1")
knob = ControlKnob(Decimals=0, Limit=False, Maximum=10, Minimum=0, Range=360, Value=0)
pt = Point(Point(0.019827702, -0.03965540401, 0))
pt_2 = Point(Point(4.897442395, 0.03965540401, 0))
pt_3 = Point(Point(5.056064011, 4.917270097, 0))
pt_4 = Point(Point(-0.019827702, 4.917270097, 0))
freepointmoment = FreePointMoment(
    LoadCase="LC2",
    Validity=0,
    Selection="Auto",
    CoordSys=4,
    Direction=0,
    LoadValue=-150,
    Points=Point(3.978138365, 2.025548552, 0))
panel_3 = Panel("""N1
N2
N3
N4""")
srf4pt = _4PointSurface(
    CornerA=Point(0.8512275638, 1.080585966, 0),
    CornerB=Point(0.7605087191, 2.89496286, 0),
    CornerC=Point(3.282492602, 2.858675323, 0),
    CornerD=Point(3.200845642, 1.18944858, 0))
srf4pt_2 = _4PointSurface(CornerA=pt, CornerB=pt_2, CornerC=pt_3, CornerD=pt_4)
nodes = Nodes(
    Points=[Point(0.9675946421, 3.876464774, 0), Point(2.167262369, 3.876464774, 0), Point(3.121709011, 3.876464774, 0)],
    NodePrefix="NSp")
panel_4 = Panel(edgesupport)
_2dmember = _2Dmember(
    Surfaces=flatten(srf4pt_2),
    Material="C20/25",
    Thickness=panel_2,
    SurfLayer="surflayerTest",
    InternalNodes=internal_nodes,
    NodePrefix="N",
    Tolerance=0.001,
    RemDuplNodes=False,
    MemberSystemPlane=1,
    EccentricityZ=0,
    FEMNonlinearModel=0,
    SurfaceNamePrefix="S",
    SwapOrientation=0,
    LCSangle=knob)  # -> Nodes, Surfaces
openings = Openings(ClosedCurves=srf4pt, Surface="S1", NodePrefix="NO", Tolerance=0.001, OpeningNamePrefix="O")  # -> Nodes, Openings
nodesupport = NodeSupport(
    ListOfNodes=panel_3,
    Rx=1,
    Ry=1,
    Rz=1,
    Tx=1,
    Ty=1,
    Tz=1,
    StiffnessRx=0,
    StiffnessRy=0,
    StiffnessRz=0,
    StiffnessTx=0,
    StiffnessTy=0,
    StiffnessTz=0,
    Angle="Rx20,Ry20,Rz20")
surfaceload = SurfaceLoad(LoadCase="LC2", SurfList="S0", CoordSys=0, Direction=2, LoadValue=-4)
panel_5 = Panel(freepointmoment)
panel_6 = Panel(nodes)
layers = Layers(LayerDefinition="surflayerTest;layer for surfaces;no")
koalaloadcases_groups = KoalaLoadCases(LoadCases="LC2; Permanent; LG1", LoadGroups="LG2; Variable; Standard")  # -> LoadCases, LoadGroups
linemomentonedge = LineMomentOnEdge(
    LoadCase="LC2",
    _2DMemberEdgeList="S1;1",
    CoordSys=0,
    Direction=2,
    Distribution=0,
    LoadValue1=-100,
    LoadValue2=-100,
    CoordDefinition=0,
    Position1=0,
    Position2=1,
    Origin=0)
subsoil = Subsoil(
    SubsoilName="Subsoil0",
    Description="Defined sobsoil for surface support",
    C1x=50,
    C1y=50,
    C1z=50,
    C2x=50,
    C2y=50,
    C1ztype=1,
    NonlinearFunction="NFL2")
panel_7 = Panel(_2dmember.Nodes)
panel_8 = Panel(layers)
panel_9 = Panel(subsoil)
surfacesupport = SurfaceSupport(SurfList="S1", Subsoil="Subsoil0")
panel_10 = Panel(_2dmember.Surfaces)
panel_11 = Panel(linemomentonedge)
createxml = CreateXML(
    StructureType=8,
    UILanguage=0,
    Materials="Concrete",
    MeshSize=0.15,
    Nodes=flatten([_2dmember.Nodes, openings.Nodes, nodes]),
    Surfaces=_2dmember.Surfaces,
    Openings=openings.Openings,
    Nodesupports=nodesupport,
    Edgesupports=edgesupport,
    Loadcases=koalaloadcases_groups.LoadCases,
    Loadgroups=koalaloadcases_groups.LoadGroups,
    Surfaceloads=surfaceload,
    FileName="C:/TEMP/2Dmember.xml",
    Scale="1",
    RemDuplNodes=False,
    OnDemand=Button(),
    Layers=layers,
    Subsoils=subsoil,
    SurfaceSupports=surfacesupport,
    LineMomentsOnEdge=linemomentonedge,
    FreeMomentPoints=freepointmoment,
    NonlinearFunctions=[nonlinearfunction_2, nonlinearfunction])
rec = DataRecorder(createxml, DataLimit=-10, RecordData=True)
panel_12 = Panel(rec)
# Syntax for sections:
# Name; Formcode; Reference; Material
# 
# Name: the name of the profile in SCIA Engineer: CS1, etc
# 
# Formcode:
# - steel profiles: FORM-X, where "X" is the formcode: https://help.scia.net/webhelplatest/en/#pvt/steelcodechecktb/annexes/annex_a_profile_library_formcodes.htm
# - concrete: CONC
# - timber: TIMB
# 
# Reference:
# - steel profiles: the naming needs to be identical with SCIA Engineer (eg: IPE200), and refer to an existing SCIA Engineer cross-section
# - concrete: the following  shapes are supported
# •	Rectangle CS1;CONC;RECTHxB;C20/25
# •	I section CS2;CONC;ISECHxBhxBsxtsxthxs;C20/25
# •	L section CS3;CONC;LSECHxBxthxsh;C20/25
# •	Reverse L section CS4;CONC;LREVHxBxthxsh;C20/25
# •	Circle CS5;CONC;CIRCD;C20/25
# •	Oval CS6;CONC;OVAL;HxB;C20/25
# 
# Material: the naming needs to be identical with a material in the SCIA Engineer project database (S 235 or C25/30 or...)
# 
# Note: there is a bug in SCIA Engineer 18.1 that will not update the formcode (required for proper steel code check) if the profile already exists in the project. Workaround: start with an empty profile list in your project, if you want to define them through Grasshopper.
internal_nodes_2 = Panel("S1|NSp1;NSp2;NSp3")
