# Grasshopper definition 2DMemberWithOpeningAndLoadPanel.gh (Grasshopper 1.0.7)
# plug-ins: Koala

# Syntax for thickness:
# constant:
# constant|200
# variable:
# variable|Global X|200;N1|400;N2 - definition of the change of the thickness and then thickness on node1 and the node 2
# Posibilities:
# Global X
# Global Y
# Global Z
# Local X
# Local Y
# Variable in two directions
# Radial (circular slabs only)
# Variable in 4 pt.
pt = Point(Point(5.159797503, 14.82887694, 0))
pt_2 = Point(Point(5.034196123, 10.0178233, 0))
pt_3 = Point(Point(10.01064367, 10.00462773, 0))
pt_4 = Point(Point(10.01474578, 15.01631608, 0))
srf4pt = _4PointSurface(CornerA=pt, CornerB=pt_2, CornerC=pt_3, CornerD=pt_4)
linehinge = LineHinge(
    _2DMemberEdgeList="S2;1",
    CoordDefinition=0,
    Position1=0,
    Position2=1,
    Origin=0,
    Rx=1,
    Tx=1,
    Ty=1,
    Tz=1,
    StiffnessRx=0,
    StiffnessTx=0,
    StiffnessTy=0,
    StiffnessTz=0)
A = StartPoint(Point(3.587175359, 0.5224049389, 0))
B = EndPoint(Point(4.140812639, 0.4779668476, 0))
A_2 = StartPoint(Point(4.191153889, 1.183145484, 0))
B_2 = EndPoint(Point(3.686518926, 1.009454481, 0))
panel = Panel("""-1;-1
0;0
1;1""")
panel_2 = Panel("""S1;3;edge
ELS1;1;internal""")
pt_5 = Point(Point(2, 2, 3))
pt_6 = Point(Point(0.019827702, -0.03965540401, 3))
ln = Line(StartPoint=A, EndPoint=B)
ln_2 = Line(StartPoint=A_2, EndPoint=B_2)
pt_7 = Point(Point(3, 2, 3))
pt_8 = Point(Point(3, 4, 3))
pt_9 = Point(Point(2, 4, 3))
pt_10 = Point(Point(4.897442395, 0.03965540401, 3))
pt_11 = Point(Point(5.056064011, 4.917270097, 3))
ln_3 = Line(StartPoint=B_2, EndPoint=A)
ln_4 = Line(StartPoint=B, EndPoint=A_2)
pt_12 = Point(Point(-0.019827702, 4.917270097, 3))
srf4pt_2 = _4PointSurface(CornerA=pt_5, CornerB=pt_7, CornerC=pt_8, CornerD=pt_9)
ln_5 = Line(StartPoint=Point(4.614024002, 4.263557749, 0), EndPoint=Point(4.625626522, 1.843713883, 0))
edgeload = EdgeLoad(
    LoadCase="LC2",
    _2DMemberEdgeList=panel_2,
    CoordSys=0,
    Direction=2,
    Distribution=0,
    LoadValue1=-1,
    LoadValue2=-1,
    CoordDefinition=0,
    Position1=0,
    Position2=1,
    Origin=0,
    Ey=0,
    Ez=0)
srf4pt_3 = _4PointSurface(CornerA=pt_6, CornerB=pt_10, CornerC=pt_11, CornerD=pt_12)
nonlinearfunction = NonlinearFunction(Name="NFL1", Type=0, PositiveEnd=0, NegativeEnd=0, GrahpPoints=panel)
pt_13 = Point(Point(0.019827702, -0.03965540401, 0))
pt_14 = Point(Point(4.897442395, 0.03965540401, 0))
pt_15 = Point(Point(5.056064011, 4.917270097, 0))
panel_3 = Panel(linehinge)
pt_16 = Point(Point(-0.019827702, 4.917270097, 0))
srf4pt_4 = _4PointSurface(
    CornerA=Point(0.8512275638, 1.080585966, 0),
    CornerB=Point(0.7605087191, 2.89496286, 0),
    CornerC=Point(3.282492602, 2.858675323, 0),
    CornerD=Point(3.200845642, 1.18944858, 0))
boundary = BoundarySurfaces(Edges=[ln, ln_4, ln_3, ln_2])
panel_4 = Panel("""N1
N2
N3
N4""")
panel_5 = Panel("""S1;1;edge
ESL1;1;internal""")
slabinternaledge = SlabInternalEdge(SurfList="S1", Lines=ln_5, InternalEdgeNamePrefix="ESL", NodePrefix="NEN", Tolerance=0.001, RemDuplNodes=False)  # -> Nodes, InternalEdges
internal_nodes = Panel("S1|NSp1;NSp2;NSp3")
srf4pt_5 = _4PointSurface(CornerA=pt_13, CornerB=pt_14, CornerC=pt_15, CornerD=pt_16)
nodes = Nodes(
    Points=[Point(0.9675946421, 3.876464774, 0), Point(2.167262369, 3.876464774, 0), Point(3.121709011, 3.876464774, 0)],
    NodePrefix="NSp")
nonlinearfunction_2 = NonlinearFunction(Name="NFL2", Type=2, PositiveEnd=0, NegativeEnd=0, GrahpPoints=panel)
knob = ControlKnob(Decimals=0, Limit=False, Maximum=10, Minimum=0, Range=360, Value=0)
loadpanels = LoadPanels(
    LoadPanelNamePrefix="LP",
    Surfaces=srf4pt,
    LoadPanelsLayer="LoadPanelsLayer",
    PanelType=2,
    TransferDirection=2,
    TransferMethod=1,
    Tolerance=0.001,
    RemDuplNodes=False,
    SwapOrientation=0,
    LCSangle=knob)  # -> Nodes, LoadPanels
ln_6 = Line(StartPoint=Point(0.7872880502, 0.5798496115, 0), EndPoint=Point(3.107454536, 0.5574897246, 0))
ln_7 = Line(StartPoint=Point(0.7872880502, 0.5798496115, 0), EndPoint=Point(3.107454536, 0.5574897246, 0))
panel_6 = Panel("""constant|300
constant|450""")
panel_7 = Panel(edgeload)
panel_8 = Panel("""S1
S2""")
thermalloadonsurface = ThermalLoadOnSurface(LoadCase="LC2", SurfList="S2", Distribution=1, Delta=1, ZTopDelta=1, ZBottomDelta=2)
linemomentonedge = LineMomentOnEdge(
    LoadCase="LC2",
    _2DMemberEdgeList=panel_5,
    CoordSys=0,
    Direction=2,
    Distribution=0,
    LoadValue1=-100,
    LoadValue2=-100,
    CoordDefinition=0,
    Position1=0,
    Position2=1,
    Origin=0)
freepointmoment = FreePointMoment(
    LoadCase="LC2",
    Validity=3,
    Selection=0,
    CoordSys=4,
    Direction=0,
    LoadValue=-150,
    Points=Point(3.978138365, 2.025548552, 0),
    ValidityFrom="-2",
    ValidityTo="2")
freelineload = FreeLineLoad(
    LoadCase="LC2",
    Validity=3,
    Selection=0,
    CoordSys=0,
    Direction=2,
    Distribution=0,
    LoadValue1=-1,
    LoadValue2=-1,
    Lines=ln_6,
    ValidityFrom="-2",
    ValidityTo="2")
freesurfaceload = FreeSurfaceLoad(
    LoadCase="LC2",
    Validity=3,
    Selection=0,
    CoordSys=0,
    Direction=2,
    LoadValue=-1,
    Boundaries=boundary,
    ValidityFrom="-2",
    ValidityTo="2")
subsoil = Subsoil(
    SubsoilName="Subsoil0",
    Description="Defined sobsoil for surface support",
    C1x=50,
    C1y=50,
    C1z=50,
    C2x=0,
    C2y=0,
    C1ztype=1,
    NonlinearFunction="NFL2")
edgesupport = EdgeSupport(
    ListOfSurfaces_EdgesType="S1;SURFACE;1",
    Rx=2,
    Ry=2,
    Rz=2,
    Tx=2,
    Ty=2,
    Tz=7,
    StiffnessRx=10,
    StiffnessRy=20,
    StiffnessRz=30,
    StiffnessTx=40,
    StiffnessTy=50,
    StiffnessTz=60,
    CoordDefinition=0,
    Position1=0.25,
    Position2=0.5,
    Origin=0,
    FunctionTz="NFL1")
freepointload = FreePointLoad(
    LoadCase="LC2",
    Validity=3,
    Selection=0,
    CoordSys=4,
    Direction=2,
    LoadValue=-1,
    Points=Point(4.025064737, 2.952786619, 0),
    ValidityFrom="-2",
    ValidityTo="2")
_2dmember = _2Dmember(
    Surfaces=flatten([srf4pt_5, srf4pt_3]),
    Material="C20/25",
    Thickness=panel_6,
    SurfLayer="surflayerTest",
    InternalNodes=internal_nodes,
    NodePrefix="N",
    Tolerance=0.001,
    RemDuplNodes=False,
    MemberSystemPlane=1,
    EccentricityZ=0,
    FEMNonlinearModel=0,
    SurfaceNamePrefix="S",
    SwapOrientation=0,
    LCSangle=knob)  # -> Nodes, Surfaces
surfaceload = SurfaceLoad(LoadCase="LC2", SurfList="S1", CoordSys=0, Direction=2, LoadValue=-4)
openings = Openings(ClosedCurves=[srf4pt_4, srf4pt_2], Surface=panel_8, NodePrefix="NO", Tolerance=0.001, OpeningNamePrefix="O")  # -> Nodes, Openings
panel_9 = Panel(slabinternaledge.InternalEdges)
surfacesupport = SurfaceSupport(SurfList="S1", Subsoil="Subsoil0")
nodesupport = NodeSupport(
    ListOfNodes=panel_4,
    Rx=1,
    Ry=1,
    Rz=1,
    Tx=1,
    Ty=1,
    Tz=1,
    StiffnessRx=0,
    StiffnessRy=0,
    StiffnessRz=0,
    StiffnessTx=0,
    StiffnessTy=0,
    StiffnessTz=0,
    Angle="Rx20,Ry20,Rz20")
panel_10 = Panel(slabinternaledge.Nodes)
koalaloadcases_groups = KoalaLoadCases(LoadCases="LC2; Permanent; LG1", LoadGroups="LG2; Variable; Standard")  # -> LoadCases, LoadGroups
panel_11 = Panel(openings.Openings)
layers = Layers(LayerDefinition="surflayerTest;layer for surfaces;no")
createxml = CreateXML(
    StructureType=8,
    UILanguage=0,
    Materials="Concrete",
    MeshSize=0.15,
    Nodes=flatten([_2dmember.Nodes, openings.Nodes, nodes, loadpanels.Nodes, slabinternaledge.Nodes]),
    Surfaces=_2dmember.Surfaces,
    Openings=openings.Openings,
    Nodesupports=nodesupport,
    Edgesupports=edgesupport,
    Loadcases=koalaloadcases_groups.LoadCases,
    Loadgroups=koalaloadcases_groups.LoadGroups,
    Surfaceloads=surfaceload,
    FreePointloads=freepointload,
    FreelLineloads=freelineload,
    FreeSurfaceloads=freesurfaceload,
    FileName="C:/TEMP/SlabLoadPanel.xml",
    Scale="1",
    RemDuplNodes=False,
    OnDemand=Button(),
    Edgeloads=edgeload,
    Layers=layers,
    Subsoils=subsoil,
    SurfaceSupports=surfacesupport,
    Loadpanels=loadpanels.LoadPanels,
    LineMomentsOnEdge=linemomentonedge,
    FreeMomentPoints=freepointmoment,
    NonlinearFunctions=[nonlinearfunction_2, nonlinearfunction],
    Tolerance=0.001,
    SlabInternalEdges=slabinternaledge.InternalEdges,
    LineHinges=linehinge,
    ThermalLoadsOnSurfaces=thermalloadonsurface)
rec = DataRecorder(createxml, DataLimit=-10, RecordData=True)
# Syntax for sections:
# Name; Formcode; Reference; Material
# 
# Name: the name of the profile in SCIA Engineer: CS1, etc
# 
# Formcode:
# - steel profiles: FORM-X, where "X" is the formcode: https://help.scia.net/webhelplatest/en/#pvt/steelcodechecktb/annexes/annex_a_profile_library_formcodes.htm
# - concrete: CONC
# - timber: TIMB
# 
# Reference:
# - steel profiles: the naming needs to be identical with SCIA Engineer (eg: IPE200), and refer to an existing SCIA Engineer cross-section
# - concrete: the following  shapes are supported
# •	Rectangle CS1;CONC;RECTHxB;C20/25
# •	I section CS2;CONC;ISECHxBhxBsxtsxthxs;C20/25
# •	L section CS3;CONC;LSECHxBxthxsh;C20/25
# •	Reverse L section CS4;CONC;LREVHxBxthxsh;C20/25
# •	Circle CS5;CONC;CIRCD;C20/25
# •	Oval CS6;CONC;OVAL;HxB;C20/25
# 
# Material: the naming needs to be identical with a material in the SCIA Engineer project database (S 235 or C25/30 or...)
# 
# Note: there is a bug in SCIA Engineer 18.1 that will not update the formcode (required for proper steel code check) if the profile already exists in the project. Workaround: start with an empty profile list in your project, if you want to define them through Grasshopper.
panel_12 = Panel(rec)
