# Grasshopper definition Example_Truss3D.gh (Grasshopper 1.0.7)
# plug-ins: Koala

panel = Panel("surflayerTest;layer for surfaces;no")

x0 = Slider(0, range=0..100)
y0 = Slider(0, range=0..100)
z0 = Slider(0, range=0..100)
x_side = Slider(4, range=0..5)
n_y = Slider(10, range=0..100)
n_x = Slider(10, range=0..100)
hi = Slider(2.3, range=0..5)
hy = Slider(4, range=0..5)
hx = Slider(3, range=0..5)
ly = Slider(45, range=1..150)
lx = Slider(30, range=1..150)
pt = ConstructPoint(XCoordinate=x0, YCoordinate=y0, ZCoordinate=z0)
neg = Negative(Value=x_side)
Y = UnitY(Factor=ly)
X = UnitX(Factor=lx)
X_2 = UnitX(Factor=neg)
Z = UnitZ(Factor=hx)
# Syntax for sections:
# Name; Formcode; Reference; Material
# 
# Name: the name of the profile in SCIA Engineer: CS1, etc
# 
# Formcode:
# - steel profiles: FORM-X, where "X" is the formcode: https://help.scia.net/webhelplatest/en/#pvt/steelcodechecktb/annexes/annex_a_profile_library_formcodes.htm
# - concrete: CONC
# 
# Reference:
# - steel profiles: the naming needs to be identical with SCIA Engineer (eg: IPE200), and refer to an existing SCIA Engineer cross-section
# - concrete: the following 2 shapes are supported
#     RECT: heigth, width (eg: RECT400x200)
#     CIRC: diameter (eg: CIRC300)
# Material: the naming needs to be identical with a material in the SCIA Engineer project database (S 235 or C25/30 or...)
# 
# Note: there is a bug in SCIA Engineer 18.1 that will not update the formcode (required for proper steel code check) if the profile already exists in the project. Workaround: start with an empty profile list in your project, if you want to define them through Grasshopper.
Z_2 = UnitZ(Factor=hy)
addition = Addition(A=X_2, B=Z_2)

cluster = Cluster_2(relay_2=pt, C=Z, relay=X)
cluster_2 = Cluster_2(relay_2=pt, C=addition, relay=Y)
mirror = Mirror(Geometry=cluster_2, Plane=PlaneYZ(0, 0, 0))  # -> Geometry, Transform
move = Move(Geometry=mirror.Geometry, Motion=X)  # -> Geometry, Transform
move_2 = Move(Geometry=cluster, Motion=Y)  # -> Geometry, Transform
explode = Explode(Curve=flatten([cluster, move_2.Geometry]), Recursive=True)  # -> Segments, Vertices
divide = DivideCurve(Curve=explode.Segments, Count=1, Kinks=False)  # -> flatten(Points), Tangents, Parameters
edgesrf = EdgeSurface(CurveA=cluster_2, CurveB=cluster, CurveC=move.Geometry, CurveD=move_2.Geometry)

crv = Curve()
loft = Loft(Curves=crv, Options={Adjust=False, Closed=False, LoftEnds=0, LoftSimp=0, LoftType=0, Rebuild=10, Refit=0.01})

sdivide = DivideSurface(Surface=edgesrf, UCount=n_x, VCount=n_y)  # -> Points, Normals, Parameters
multiplication = Multiplication(A=sdivide.Normals, B=hi)
addition_2 = Addition(A=sdivide.Points, B=multiplication)
flip = FlipMatrix(Data=sdivide.Points)
flip_2 = FlipMatrix(Data=addition_2)
ln = Line(StartPoint=sdivide.Points, EndPoint=addition_2)
cluster_3 = Cluster_5(relay=flip, relay_2=flip_2)  # -> S_2, S, L, L_2
cluster_4 = Cluster_5(relay=sdivide.Points, relay_2=addition_2)  # -> S_2, S, L, L_2
cluster_5 = Cluster(
    relay_8=cluster_3.S_2,
    relay_3=cluster_3.S,
    relay=cluster_4.S_2,
    relay_2=cluster_4.S,
    relay_4=cluster_3.L,
    relay_9=cluster_3.L_2,
    relay_6=cluster_4.L,
    relay_7=cluster_4.L_2,
    relay_5=ln)  # -> R, R_2

lng = ListLength(List=flatten(cluster_3.S_2))
series = Series(Start=1, Step=1, Count=lng)

lng_2 = ListLength(List=flatten([cluster_4.S_2, cluster_4.S, cluster_3.S_2, cluster_3.S]))
lng_3 = ListLength(List=flatten([ln, cluster_4.L, cluster_4.L_2, cluster_3.L, cluster_3.L_2]))
addition_3 = Addition(A=lng_2, B=1)
series_2 = Series(Start=addition_3, Step=1, Count=lng_3)

pipe = Pipe(Curve=[cluster_3.S_2, cluster_3.S, cluster_4.S_2, cluster_4.S], Radius=0.13, Caps=0)
pipe_2 = Pipe(Curve=[cluster_3.L, cluster_3.L_2, cluster_4.L, cluster_4.L_2, ln], Radius=0.08, Caps=0)
output_file_name = Panel("C:\Temp\KoalaTruss.xml")

autoupdate = BooleanToggle(False)
run_esa_xml_exe = Button()
template_file_name = Panel("C:\WORK\SourceCodes\SciaOpenAPI_example_CSharp_simple_structure\res\OpenAPIEmptyProject.esa")
outputfile = Panel("C:\Temp\ResultsTruss.txt")
search_result = Panel("My")
path_to_esa_xml_exe = Panel("C:\Program Files (x86)\Scia\Engineer19.1\ESA_XML.exe")
calculationtype = Panel("LIN")
concat = Concatenate(FragmentB=outputfile)

# ---- group: General parameters
tolerance = Panel("0.0001")
avoid_duplicate_nodes_slow = BooleanToggle(True)
average_size_of_2d_curved_elements_m = Panel("0.15")
scale = Panel("1")

# ----
sections = Panel("""CS1;FORM-1;HEB200;S 235
CS2;FORM-1;HEA200;S 235
CS3;FORM-4;L100X8;S 235
CS4;FORM-4;L80X8;S 235
CS5;FORM-4;L70X5;S 355
CS6;FORM-11;RD20;S 355
CS7;CONC;RECT1200x300;C30/37""")
load_cases = Panel("""LC1; SW; LG1
LC2; Permanent; LG1
LC3; Variable; LG2""")
load_groups = Panel("""LG1; Permanent
LG2; Variable; Standard""")
layers = Panel("Beams")
concat_2 = Concatenate(FragmentA="B", FragmentB=series_2)
concat_3 = Concatenate(FragmentA="B", FragmentB=series)
node_prefix = Panel("N")
load_case = Panel("LC2")
value_kn_m = Panel("-3")
beams = Beams(
    Curves=cluster_5.R,
    Sections=cluster_5.R_2,
    Layers=layers,
    NodePrefix=node_prefix,
    Tolerance=tolerance,
    RemDuplNodes=avoid_duplicate_nodes_slow,
    FEMStructuralType=0,
    FEMType=0,
    MemberSystemLine=1,
    Ey=0,
    Ez=0,
    BeamNamePrefix="B")  # -> Nodes, Beams
cluster_6 = Cluster_4(relay=beams.Nodes, M=divide.Points, A=node_prefix)
cross_sections = Cross_Sections(Sections=sections)
koalaloadcases_groups = KoalaLoadCases(LoadCases=load_cases, LoadGroups=load_groups)  # -> LoadCases, LoadGroups

beamloads = BeamLoads(
    LoadCase=load_case,
    BeamList=concat_3,
    CoordSys=0,
    Direction=2,
    Distribution=0,
    LoadValue1=value_kn_m,
    LoadValue2=-1,
    CoordDefinition=0,
    Position1=0,
    Position2=1,
    Origin=0,
    Ey=0,
    Ez=0)
hinges = Hinges(
    Hinges=concat_2,
    Position=2,
    Rx=0,
    Ry=0,
    Rz=0,
    Tx=1,
    Ty=1,
    Tz=1,
    StiffnessRx=0,
    StiffnessRy=0,
    StiffnessRz=0,
    StiffnessTx=0,
    StiffnessTy=0,
    StiffnessTz=0)
panel_2 = Panel(beams.Beams)
nodesupport = NodeSupport(
    ListOfNodes=cluster_6,
    Rx=0,
    Ry=0,
    Rz=0,
    Tx=1,
    Ty=1,
    Tz=1,
    StiffnessRx=0,
    StiffnessRy=0,
    StiffnessRz=0,
    StiffnessTx=0,
    StiffnessTy=0,
    StiffnessTz=0,
    Angle="Rx0,Ry0,Rz0")
projectinfo = ProjectInfo(
    ProjectName="Project 1",
    Part="Project 1",
    Description="Your description for project",
    Author="Your Name",
    Date="02-01-2020")
linearcombination = LinearCombination(Name="C1", Type=2, CombinationInput="1.35*LC1;1.5*LC2;2*LC3")
create_xml_file = Button()
analysis = Analysis(
    FileName=output_file_name,
    ESAXMLPath=path_to_esa_xml_exe,
    CalcType=0,
    TemplateName=template_file_name,
    OutputFile=outputfile,
    RunESAXML=run_esa_xml_exe)  # -> Message, OutputFile, SavedSEProject
layers_2 = Layers(LayerDefinition="Beams;layer for Beams;no")
list = ValueList({"Concrete", "Steel", "Timber"}, selected=["Concrete", "Steel", "Timber"])
rec = DataRecorder(analysis.Message, DataLimit=-10, RecordData=True)
createxml = CreateXML(
    StructureType=8,
    UILanguage=0,
    Materials=list,
    MeshSize=average_size_of_2d_curved_elements_m,
    Sections=cross_sections,
    Nodes=beams.Nodes,
    Beams=beams.Beams,
    Nodesupports=nodesupport,
    Loadcases=koalaloadcases_groups.LoadCases,
    Loadgroups=koalaloadcases_groups.LoadGroups,
    Lineloads=beamloads,
    Hinges=hinges,
    FileName=output_file_name,
    Scale=scale,
    RemDuplNodes=avoid_duplicate_nodes_slow,
    OnDemand=create_xml_file,
    LinCombinations=linearcombination,
    ProjectInformation=projectinfo,
    Layers=layers_2,
    Tolerance=0.001)
panel_3 = Panel(rec)
# KOALA
# SCIA Engineer
# plugin
rec_2 = DataRecorder(createxml, DataLimit=-10, RecordData=True)
# Syntax for sections:
# Name; Formcode; Reference; Material
# 
# Name: the name of the profile in SCIA Engineer: CS1, etc
# 
# Formcode:
# - steel profiles: FORM-X, where "X" is the formcode: https://help.scia.net/webhelplatest/en/#pvt/steelcodechecktb/annexes/annex_a_profile_library_formcodes.htm
# - concrete: CONC
# - timber: TIMB
# 
# Reference:
# - steel profiles: the naming needs to be identical with SCIA Engineer (eg: IPE200), and refer to an existing SCIA Engineer cross-section
# - concrete: the following  shapes are supported
# •	Rectangle CS1;CONC;RECTHxB;C20/25
# •	I section CS2;CONC;ISECHxBhxBsxtsxthxs;C20/25
# •	L section CS3;CONC;LSECHxBxthxsh;C20/25
# •	Reverse L section CS4;CONC;LREVHxBxthxsh;C20/25
# •	Circle CS5;CONC;CIRCD;C20/25
# •	Oval CS6;CONC;OVAL;HxB;C20/25
# 
# Material: the naming needs to be identical with a material in the SCIA Engineer project database (S 235 or C25/30 or...)
# 
# Note: there is a bug in SCIA Engineer 18.1 that will not update the formcode (required for proper steel code check) if the profile already exists in the project. Workaround: start with an empty profile list in your project, if you want to define them through Grasshopper.
panel_4 = Panel(rec_2)

# ==== cluster Cluster
relay = ClusterInput()
relay_2 = ClusterInput()
relay_3 = ClusterInput()
relay_4 = ClusterInput()
relay_5 = ClusterInput()
relay_6 = ClusterInput()
relay_7 = ClusterInput()
relay_8 = ClusterInput()
relay_9 = ClusterInput()
combine = CombineData(Input0="CS2", Input1=flatten(relay_8))  # -> Result, Index
combine_2 = CombineData(Input0="CS1", Input1=flatten(relay_3))  # -> Result, Index
combine_3 = CombineData(Input0="CS2", Input1=flatten(relay))  # -> Result, Index
combine_4 = CombineData(Input0="CS1", Input1=flatten(relay_2))  # -> Result, Index
combine_5 = CombineData(Input0="CS3", Input1=flatten(relay_4))  # -> Result, Index
combine_6 = CombineData(Input0="CS4", Input1=flatten(relay_9))  # -> Result, Index
combine_7 = CombineData(Input0="CS4", Input1=flatten(relay_6))  # -> Result, Index
combine_8 = CombineData(Input0="CS4", Input1=flatten(relay_7))  # -> Result, Index
combine_9 = CombineData(Input0="CS4", Input1=flatten(relay_5))  # -> Result, Index
entwine = Entwine(
    Branch00=relay_8,
    Branch01=relay_3,
    Branch02=relay,
    Branch03=relay_2,
    Branch04=relay_4,
    Branch05=relay_9,
    Branch06=relay_6,
    Branch07=relay_7,
    Branch08=relay_5,
    FlattenInputs=True)  # -> flatten(Result)
entwine_2 = Entwine(
    Branch00=combine.Result,
    Branch01=combine_2.Result,
    Branch02=combine_3.Result,
    Branch03=combine_4.Result,
    Branch04=combine_5.Result,
    Branch05=combine_6.Result,
    Branch06=combine_7.Result,
    Branch07=combine_8.Result,
    Branch08=combine_9.Result,
    FlattenInputs=True)  # -> flatten(Result)
R = ClusterOutput(entwine)
R_2 = ClusterOutput(entwine_2)

# ==== cluster Cluster_2
relay = ClusterInput()
relay_2 = ClusterInput()
division = Division(A=relay, B=2)
C = ClusterInput()
addition = Addition(A=relay_2, B=division, C=C)
addition_2 = Addition(A=relay_2, B=relay)
arc = Arc3Pt(PointA=relay_2, PointB=addition, PointC=addition_2)  # -> Arc, Plane, Radius
A = ClusterOutput(arc.Arc)

# ==== cluster Cluster_4
M = ClusterInput()
relay = ClusterInput()
A = ClusterInput()
B = ClusterInput()
cluster = Cluster_3(relay=relay)
mindex = MemberIndex(Set=cluster, Member=M)  # -> flatten(Index), Count
addition = Addition(A=mindex.Index, B=1)
concat = Concatenate(FragmentA=A, FragmentB=addition)
R = ClusterOutput(concat)

# ==== cluster Cluster_5
relay = ClusterInput()
relay_2 = ClusterInput()
lng = ListLength(List=relay_2)
lng_2 = ListLength(List=relay_2)
pline = PolyLine(Vertices=relay, Closed=False)
pline_2 = PolyLine(Vertices=relay_2, Closed=False)
subtraction = Subtraction(A=lng, B=1)
subtraction_2 = Subtraction(A=lng_2, B=1)
cull_i = CullIndex(List=relay, Indices=flatten("0"), Wrap=True)
cull_i_2 = CullIndex(List=relay_2, Indices=flatten(subtraction), Wrap=True)
cull_i_3 = CullIndex(List=relay, Indices=flatten(subtraction_2), Wrap=True)
cull_i_4 = CullIndex(List=relay_2, Indices=flatten("0"), Wrap=True)
explode = Explode(Curve=pline, Recursive=True)  # -> Segments, Vertices
explode_2 = Explode(Curve=pline_2, Recursive=True)  # -> Segments, Vertices
ln = Line(StartPoint=cull_i, EndPoint=cull_i_2)
ln_2 = Line(StartPoint=cull_i_3, EndPoint=cull_i_4)
S = ClusterOutput(explode.Segments)
S_2 = ClusterOutput(explode_2.Segments)
L = ClusterOutput(ln)
L_2 = ClusterOutput(ln_2)

# ==== cluster Cluster_3
relay = ClusterInput()
cull = CullPattern(List=relay, CullPattern=[False, True, False, False])
cull_2 = CullPattern(List=relay, CullPattern=[False, False, True, False])
cull_3 = CullPattern(List=relay, CullPattern=[False, False, False, True])
multiplication = Multiplication(A=cull_3, B=1000)
multiplication_2 = Multiplication(A=cull_2, B=1000)
multiplication_3 = Multiplication(A=cull, B=1000)
round = Round(Number=multiplication)  # -> Nearest, Floor, Ceiling
round_2 = Round(Number=multiplication_2)  # -> Nearest, Floor, Ceiling
round_3 = Round(Number=multiplication_3)  # -> Nearest, Floor, Ceiling
division = Division(A=round.Nearest, B=1000)
division_2 = Division(A=round_2.Nearest, B=1000)
division_3 = Division(A=round_3.Nearest, B=1000)
pt = ConstructPoint(XCoordinate=division_3, YCoordinate=division_2, ZCoordinate=division)
pt_2 = ClusterOutput(pt)
