# Grasshopper definition Example_Voronoi.gh (Grasshopper 1.0.7)
# plug-ins: Test, Koala, Parakeet, Kangaroo2 Components

x0 = Slider(0, range=0..100)
y0 = Slider(0, range=0..100)
z0 = Slider(0, range=0..100)
x_side = Slider(4, range=0..5)
n_x = Slider(14, range=0..100)
n_y = Slider(12, range=0..100)
hy = Slider(4, range=0..5)
hi = Slider(2.3, range=0..5)
ly = Slider(60, range=1..150)
hx = Slider(3, range=0..5)
lx = Slider(30, range=1..150)
pt = ConstructPoint(XCoordinate=x0, YCoordinate=y0, ZCoordinate=z0)
neg = Negative(Value=x_side)
Y = UnitY(Factor=ly)
X = UnitX(Factor=lx)
X_2 = UnitX(Factor=neg)
Z = UnitZ(Factor=hx)
Z_2 = UnitZ(Factor=hy)
addition = Addition(A=X_2, B=Z_2)

cluster = Cluster(relay_2=pt, C=Z, relay=X)
cluster_2 = Cluster(relay_2=pt, C=addition, relay=Y)
mirror = Mirror(Geometry=cluster_2, Plane=PlaneYZ(0, 0, 0))  # -> Geometry, Transform
move = Move(Geometry=mirror.Geometry, Motion=X)  # -> Geometry, Transform
move_2 = Move(Geometry=cluster, Motion=Y)  # -> Geometry, Transform
explode = Explode(Curve=flatten([cluster, move_2.Geometry]), Recursive=True)  # -> Segments, Vertices
divide = DivideCurve(Curve=explode.Segments, Count=1, Kinks=False)  # -> flatten(Points), Tangents, Parameters
edgesrf = EdgeSurface(CurveA=cluster_2, CurveB=cluster, CurveC=move.Geometry, CurveD=move_2.Geometry)

crv = Curve([<curve referenced from the Rhino model> x3])
loft = Loft(Curves=crv, Options={Adjust=False, Closed=False, LoftEnds=0, LoftSimp=0, LoftType=0, Rebuild=10, Refit=0.01})

popgeo = PopulateGeometry(Geometry=edgesrf, Count=Slider(200, range=0..250), Seed=1)
voronoisrf = VoronoiOnSurface(Points=popgeo, Target=edgesrf)
explode_2 = Explode(Curve=voronoisrf, Recursive=True)  # -> flatten(Segments), Vertices
dupln = RemoveDuplicateLines(Lines=explode_2.Segments, Tolerance=0.01)
combine = CombineData(Input0="CS7", Input1=dupln)  # -> Result, Index

lng = ListLength(List=combine.Result)
series = Series(Start=1, Step=1, Count=lng)

# ---- group: General parameters
output_file_name = Panel("C:\TEMP\KoalaVoronoi.xml")
ui_language_scia_engineer = ValueList({"English": 0, "Nederlands": 1, "Français": 2, "Deutsch": 3, "Čeština": 4, "Slovenčina": 5}, selected="English")
avoid_duplicate_nodes_slow = BooleanToggle(True)
structure_type = ValueList({"Frame XZ", "Frame XYZ", "General XYZ"}, selected="General XYZ")
average_size_of_2d_curved_elements_m = Panel("0.15")
scale = Panel("1")
tolerance = Panel("0.0001")
list = ValueList({"Concrete", "Steel", "Timber"}, selected=["Concrete", "Steel", "Timber"])

# ----
load_cases = Panel("""LC1; SW; LG1
LC2; Permanent; LG1
LC3; Variable; LG2""")
load_groups = Panel("""LG1; Permanent
LG2; Variable; Standard""")
concat = Concatenate(FragmentA="B", FragmentB=series)
supported_dofs = Panel("111000")
sections = Panel("CS7;CONC;RECT1200x300;GL 24c")
distribution = ValueList({"Uniform", "Trapesoidal": "Trapez"}, selected="Uniform")
layers = Panel("Layer1")
node_prefix = Panel("N")
coord_system = ValueList({"GCS", "LCS"}, selected="GCS")
direction = ValueList({"X", "Y", "Z"}, selected="Z")
load_case = Panel("LC2")
value_kn_m = Panel("-4")
beams = Beams(
    Curves=dupln,
    Sections=combine.Result,
    Layers=layers,
    NodePrefix=node_prefix,
    Tolerance=tolerance,
    RemDuplNodes=avoid_duplicate_nodes_slow,
    FEMStructuralType="general",
    FEMType="standard",
    MemberSystemLine="Centre",
    Ey=0,
    Ez=0)  # -> Nodes, Beams
cluster_3 = Cluster_3(relay=beams.Nodes, M=divide.Points, A=node_prefix, B=supported_dofs)
nodesupport = NodeSupport(NodeSupports=cluster_3)
pointloadonbeam = PointLoadOnBeam(
    LoadCase="LC2",
    BeamList="B1",
    CoordSys="GCS",
    Direction="Z",
    LoadValue=-1,
    CoordDefinition="Rela",
    Position=0.5,
    Origin="From start",
    Ey=0,
    Ez=0)
beamloads = BeamLoads(
    LoadCase=load_case,
    BeamList=concat,
    CoordSys=coord_system,
    Direction=direction,
    Distribution=distribution,
    LoadValue1=value_kn_m,
    LoadValue2=-1,
    CoordDefinition="Rela",
    Position1=0,
    Position2=1,
    Origin="From start",
    Ey=0,
    Ez=0)
cross_sections = Cross_Sections(Sections=sections)
pointloadonstructnode = PointLoadOnStructNode(LoadCase=load_case, NodeList="N1", CoordSys=coord_system, Direction=direction, LoadValue="-4")
koalaloadcases_groups = KoalaLoadCases(LoadCases=load_cases, LoadGroups=load_groups)  # -> LoadCases, LoadGroups

run_esa_xml_exe = Button()
path_to_esa_xml_exe = Panel("C:\Program Files (x86)\Scia\Engineer19.1\ESA_XML.exe")
calculationtype = Panel("LIN")
template_file_name = Panel("C:\Temp\TemplateWithPrincipalStresses.esa")
outputfile = Panel("C:\TEMP\ResultsVoronoi.txt")
autoupdate = BooleanToggle(False)
analysis = Analysis(
    FileName=output_file_name,
    ESAXMLPath=path_to_esa_xml_exe,
    CalcType=calculationtype,
    TemplateName=template_file_name,
    OutputFile=outputfile,
    AutoUpdate=autoupdate,
    RunESAXML=run_esa_xml_exe)  # -> Message, OutputFile
combine_2 = CombineData(Input0=outputfile, Input1=analysis.Message)  # -> Result, Index

# ----
# KOALA
# SCIA Engineer
# plugin
create_xml_file = Button()
autoupdate_2 = BooleanToggle(False)
createxml = CreateXML(
    StructureType=structure_type,
    UILanguage=ui_language_scia_engineer,
    Materials=list,
    MeshSize=average_size_of_2d_curved_elements_m,
    Sections=cross_sections,
    Nodes=beams.Nodes,
    Beams=beams.Beams,
    Nodesupports=nodesupport,
    Loadcases=koalaloadcases_groups.LoadCases,
    Loadgroups=koalaloadcases_groups.LoadGroups,
    Lineloads=beamloads,
    FileName=output_file_name,
    Scale=scale,
    RemDuplNodes=False,
    AutoUpdate=autoupdate_2,
    OnDemand=create_xml_file,
    PointloadsonPoints=pointloadonstructnode,
    PointloadsonBeams=pointloadonbeam)
panel = Panel(createxml)

principalstresses1d = PrincipalStresses1D(FilePath=combine_2.Result, NamePrefix="B")  # -> TensileStresses, CompressiveStresses, VonMisesStresses
cull = CullPattern(List=principalstresses1d.VonMisesStresses, CullPattern=[False, True])
division = Division(A=cull, B=100)
gradient = Gradient(
    LowerLimit=20,
    UpperLimit=100,
    Parameter=cull,
    stops=[0.0336: RGB(133, 49, 219), 0.444: RGB(255, 130, 160), 0.667: RGB(218, 233, 120), 1: RGB(220, 0, 40)])
addition_2 = Addition(A=division, B=0.3)
pipe = Pipe(Curve=dupln, Radius=addition_2, Caps=0)  # -> flatten(Pipe)
preview = CustomPreview(Geometry=pipe, Material=flatten(gradient))

# ==== cluster Cluster
relay = ClusterInput()
relay_2 = ClusterInput()
division = Division(A=relay, B=2)
C = ClusterInput()
addition = Addition(A=relay_2, B=division, C=C)
addition_2 = Addition(A=relay_2, B=relay)
arc = Arc3Pt(PointA=relay_2, PointB=addition, PointC=addition_2)  # -> Arc, Plane, Radius
A = ClusterOutput(arc.Arc)

# ==== cluster Cluster_3
M = ClusterInput()
relay = ClusterInput()
A = ClusterInput()
cluster = Cluster_2(relay=relay)
mindex = MemberIndex(Set=cluster, Member=M)  # -> flatten(Index), Count
addition = Addition(A=mindex.Index, B=1)
B = ClusterInput()
concat = Concatenate(FragmentA=A, FragmentB=addition)
concat_2 = Concatenate(FragmentA=concat, FragmentB=B, JoinSeparator=";")
R = ClusterOutput(concat_2)

# ==== cluster Cluster_2
relay = ClusterInput()
cull = CullPattern(List=relay, CullPattern=[False, True, False, False])
cull_2 = CullPattern(List=relay, CullPattern=[False, False, True, False])
cull_3 = CullPattern(List=relay, CullPattern=[False, False, False, True])
multiplication = Multiplication(A=cull_3, B=1000)
multiplication_2 = Multiplication(A=cull_2, B=1000)
multiplication_3 = Multiplication(A=cull, B=1000)
round = Round(Number=multiplication)  # -> Nearest, Floor, Ceiling
round_2 = Round(Number=multiplication_2)  # -> Nearest, Floor, Ceiling
round_3 = Round(Number=multiplication_3)  # -> Nearest, Floor, Ceiling
division = Division(A=round.Nearest, B=1000)
division_2 = Division(A=round_2.Nearest, B=1000)
division_3 = Division(A=round_3.Nearest, B=1000)
pt = ConstructPoint(XCoordinate=division_3, YCoordinate=division_2, ZCoordinate=division)
pt_2 = ClusterOutput(pt)
