# Grasshopper definition Frame.gh (Grasshopper 1.0.7)
# plug-ins: Excel, Koala

sections = Panel("""CS1;FORM-5;UPE240;S 235
CS2;FORM-1;HEA200;S 235
CS3;FORM-4;L100X8;S 235
CS4;FORM-4;L80X8;S 235
CS5;FORM-4;L70X5;S 355
CS6;FORM-11;RD20;S 355
CS7;CONC;RECT1200x300;C30/37
CS10;CONC;TSEC1200x300x150x75;C30/37
CS11;CONC;ISEC1200x400x300x200x150x75;C30/37
C12;CONC;LSEC1000x300x100x75;C30/37
C13;CONC;LREV1000x300x100x75;C30/37
C14;TIMB;RECT450x450;C14 (EN 338)
C15;TIMB;CIRC400;C14 (EN 338)
C16;TIMB;ISEC500x45x450x30x600x20;C14 (EN 338)
C17;TIMB;TSEC500x45x450x30;C14 (EN 338)""")
freepointload = FreePointLoad(
    LoadCase="LC2",
    Validity=3,
    Selection=0,
    CoordSys=4,
    Direction=2,
    LoadValue=-1,
    Points=Point(-1.990049844, 3.686256156, 0),
    ValidityFrom=0,
    ValidityTo=2)
panel = Panel("""0;0
1;10000""")
noderigidarm = NodeRigidArm(RigidArmsPrefix="RA", MasterNode="BN1", SlaveNodes="BN4", HingeOnMaster=False, HingeOnSlave=False)
pt = Point(Point(4, 0, 0))
pt_2 = Point(Point(0, 0, 0))
pt_3 = Point(Point(4, 0, 4))
pt_4 = Point(Point(0, 0, 4))
cross_sections = Cross_Sections(Sections=sections)
nonlinearfunction = NonlinearFunction(Name="NLF1", Type=0, PositiveEnd=0, NegativeEnd=0, GrahpPoints=panel)
ln = Line(StartPoint=pt_2, EndPoint=pt_4)
ln_2 = Line(StartPoint=pt_4, EndPoint=pt_3)
ln_3 = Line(StartPoint=pt_3, EndPoint=pt)
panel_2 = Panel(noderigidarm)
panel_3 = Panel("""BN2
BN3""")
panel_4 = Panel("""CS1
CS10""")
presstensiononlybeamnl = PressTensionOnlyBeamNl(BeamList="B1", Type=0)
load_cases = Panel("""LC1; SW; LG1
LC2; Permanent; LG1
LC3; Variable; LG2""")
load_groups = Panel("""LG1; Permanent
LG2; Variable; Standard""")
pt_5 = Point(Point(0, 0, 1.5))
tolerance = Panel("0.0001")
beaminternalnode = BeamInternalNode(PointList=pt_5, BeamNames="B1", NodePrefix="N")
cable = Cable(BeamList="B1", InitialMesh=0, NormalForceKN=10, SelfWeigth=True, PnKNM=0, AlphaXDeg=0)
thermalloadonbeam = ThermalLoadOnBeam(
    LoadCase="LC2",
    BeamList="B2",
    Distribution=1,
    Delta=1,
    ZTopDelta=1,
    ZBottomDelta=10,
    YLeftDelta=5,
    YBottomDelta=12,
    CoordDefinition=0,
    Position1=0,
    Position2=1,
    Origin=0)
pointsupportonbeam = PointSupportOnBeam(
    ListOfBeams="B3",
    Rx=2,
    Ry=2,
    Rz=2,
    Tx=2,
    Ty=2,
    Tz=2,
    StiffnessRx=10,
    StiffnessRy=20,
    StiffnessRz=30,
    StiffnessTx=40,
    StiffnessTy=50,
    StiffnessTz=60,
    CoordDefinition=0,
    Positionx=0.5,
    Origin=0,
    Repeat=2,
    DeltaX=0.1)
beamsupport = BeamSupport(
    ListOfBeams="B1",
    Rx=2,
    Ry=2,
    Rz=2,
    Tx=2,
    Ty=2,
    Tz=2,
    StiffnessRx=10,
    StiffnessRy=20,
    StiffnessRz=30,
    StiffnessTx=40,
    StiffnessTy=50,
    StiffnessTz=60,
    CoordDefinition=0,
    Position1=0.25,
    Position2=0.5,
    Origin=0)
linemomentonbeam = LineMomentOnBeam(
    LoadCase="LC2",
    BeamList="B2",
    CoordSys=0,
    Direction=1,
    Distribution=0,
    LoadValue1=-1,
    LoadValue2=-1,
    CoordDefinition=0,
    Position1=0,
    Position2=1,
    Origin=0)
beams = Beams(
    Curves=flatten([ln, ln_2, ln_3]),
    Sections=panel_4,
    Layers="Beams",
    NodePrefix="BN",
    Tolerance=tolerance,
    RemDuplNodes=Toggle(False),
    StructuralType=0,
    FEMType=0,
    MemberSystemLine=1,
    Ey=0,
    Ez=0,
    BeamNamePrefix="B")  # -> Nodes, Beams
nodesupport = NodeSupport(
    ListOfNodes="BN1",
    Rx=2,
    Ry=2,
    Rz=2,
    Tx=2,
    Ty=2,
    Tz=2,
    StiffnessRx=10,
    StiffnessRy=20,
    StiffnessRz=30,
    StiffnessRx_2=40,
    StiffnessTy=50,
    StiffnessTz=60,
    Angle="Rx10,Ry20,Rz30")
beamloads = BeamLoads(
    LoadCase="LC2",
    BeamList="B2",
    CoordSys=0,
    Direction=2,
    Distribution=1,
    LoadValue1=-5,
    LoadValue2=-10,
    CoordDefinition=0,
    Position1=0.25,
    Position2=1,
    Origin=0,
    Ey=0,
    Ez=0)
pointmomentonbeam = PointMomentOnBeam(
    LoadCase="LC2",
    BeamList="B2",
    CoordSys=0,
    Direction=2,
    LoadValue=-1,
    CoordDefinition=0,
    Position=0.5,
    Origin=0,
    Repeat=2,
    DeltaX=0.1)
pointmomentonstructnode = PointMomentOnStructNode(LoadCase="LC2", NodeList=panel_3, CoordSys=0, Direction=2, LoadValue=-1)
pointloadonbeam = PointLoadOnBeam(
    LoadCase="LC3",
    BeamList="B2",
    CoordSys=0,
    Direction=2,
    LoadValue="-150",
    CoordDefinition=0,
    Position=0.5,
    Origin=0,
    Repeat="2",
    Ey=0,
    Ez=0,
    DeltaX="0.1")
pointloadonstructnode = PointLoadOnStructNode(LoadCase="LC2", NodeList=panel_3, CoordSys=0, Direction=2, LoadValue="-25", Angle="Rx45,Ry0,Rz0")
presstensiononlybeamnl_2 = PressTensionOnlyBeamNl(BeamList="B2", Type=1)
koalaloadcases_groups = KoalaLoadCases(LoadCases=load_cases, LoadGroups=load_groups)  # -> LoadCases, LoadGroups
panel_5 = Panel(cable)
panel_6 = Panel(beaminternalnode)
panel_7 = Panel(beams.Beams)
panel_8 = Panel(thermalloadonbeam)
limitforcelocalbeamnl = LimitForceLocalBeamNL(BeamList="B3", Direction=0, Type=1, MarginalForce_kN=100)
gaplocalbeamnl = GapLocalBeamNL(BeamList="B1", Type=0, DisplacementMm=10, Position=0)
average_size_of_2d_curved_elements_m = Panel("0.15")
scale = Panel("1")
path = FilePath("C:\TEMP\Template.esa")
list = ValueList({"Concrete", "Steel", "Timber"}, selected=["Concrete", "Steel", "Timber"])
path_2 = FilePath("C:\Program Files (x86)\SCIA\Engineer19.1\ESA_XML.exe")
path_3 = FilePath("C:\TEMP\TemplateWithInternalForces.esa")
analysis = Analysis(
    FileName="C:\TEMP\KoalaFrame.xml",
    ESAXMLPath=path_2,
    CalcType=0,
    TemplateName=path_3,
    OutputFile="C:\TEMP\Koala.xlsx",
    RunESAXML=Button(),
    SavedSEProject=path)  # -> Message, OutputFile, SavedSEProject
createxml = CreateXML(
    StructureType=8,
    UILanguage=0,
    Materials=list,
    MeshSize=average_size_of_2d_curved_elements_m,
    Sections=cross_sections,
    Nodes=beams.Nodes,
    Beams=beams.Beams,
    Nodesupports=nodesupport,
    Loadcases=koalaloadcases_groups.LoadCases,
    Loadgroups=koalaloadcases_groups.LoadGroups,
    Lineloads=beamloads,
    FreePointloads=freepointload,
    FileName="C:\TEMP\KoalaFrame.xml",
    Scale=scale,
    RemDuplNodes=Toggle(True),
    OnDemand=Button(),
    PointloadsonPoints=pointloadonstructnode,
    PointloadsonBeams=pointloadonbeam,
    PressTensionBeamNL=presstensiononlybeamnl_2,
    LimitForceBeamNL=limitforcelocalbeamnl,
    BeamLineSupports=beamsupport,
    PointSupportsOnBeam=pointsupportonbeam,
    PointMomentsOnNodes=pointmomentonstructnode,
    PointMomentsOnBeams=pointmomentonbeam,
    LineMomentsOnBeams=linemomentonbeam,
    NonlinearFunctions=nonlinearfunction,
    Tolerance=tolerance,
    RigidArms=noderigidarm,
    CableElementsBeamNL=cable,
    BeamInternalNodes=beaminternalnode,
    ThermalLoadsOnBeams=thermalloadonbeam)
rec = DataRecorder(analysis.OutputFile, DataLimit=-10, RecordData=True)
rec_2 = DataRecorder(analysis.Message, DataLimit=-10, RecordData=True)
rec_3 = DataRecorder(createxml, DataLimit=-10, RecordData=True)
panel_9 = Panel(rec)
panel_10 = Panel(rec_3)
panel_11 = Panel(rec_2)
path_4 = FilePath("C:\TEMP\Koala.xlsx")
read = ExcelRead(Start=Toggle(False), FilePath=path_4, SheetName="1. 1D internal forces", Range="A1:I14")  # -> flatten(Data)
panel_12 = Panel(read)
