# Grasshopper definition Loadpanels.gh (Grasshopper 1.0.7)
# plug-ins: Koala

number_slider = Slider(4, range=0..10)
vec = VectorXYZ(XComponent=Slider(2.2, range=0..10), YComponent=Slider(2.2, range=0..10), ZComponent=5)  # -> Vector, Length
pt = Point(Point(0.019827702, -0.03965540401, 0))
pt_2 = Point(Point(4.897442395, 0.03965540401, 0))
pt_3 = Point(Point(5.056064011, 4.917270097, 0))
pt_4 = Point(Point(-0.019827702, 4.917270097, 0))
arc = Arc(Plane=vec.Vector, Radius=number_slider, Angle=Domain(3.141592654, 6.283185307))  # -> Arc, Length
arc_2 = Arc(Plane=vec.Vector, Radius=number_slider, Angle=Domain(0, 3.141592654))  # -> Arc, Length
cir = Circle(Plane=vec.Vector, Radius=number_slider)
ln = Line(StartPoint=pt, EndPoint=pt_2)
boundary = BoundarySurfaces(Edges=[arc_2.Arc, arc.Arc])
ln_2 = Line(StartPoint=pt_3, EndPoint=pt_4)
ln_3 = Line(StartPoint=pt_2, EndPoint=pt_3)
ln_4 = Line(StartPoint=pt_4, EndPoint=pt)
srf4pt = _4PointSurface(CornerA=pt, CornerB=pt_2, CornerC=pt_3, CornerD=pt_4)
line = Line([ln, ln_3, ln_2, ln_4])
sections = Panel("CS7;CONC;RECT1200x300;C30/37")
knob = ControlKnob(Decimals=0, Limit=False, Maximum=10, Minimum=0, Range=360, Value=0)
edgeload = EdgeLoad(
    LoadCase="LC2",
    _2DMemberEdgeList="LP2;1;edge",
    CoordSys=0,
    Direction=2,
    Distribution=0,
    LoadValue1=-1,
    LoadValue2=-1,
    CoordDefinition=0,
    Position1=0,
    Position2=1,
    Origin=0,
    Ey=0,
    Ez=0)
beams = Beams(
    Curves=flatten([line, arc_2.Arc, arc.Arc]),
    Sections="CS7",
    Layers="Beams",
    NodePrefix="NB",
    Tolerance=0.001,
    RemDuplNodes=False,
    StructuralType=0,
    FEMType=0,
    MemberSystemLine=1,
    Ey=0,
    Ez=0,
    BeamNamePrefix="B")  # -> Nodes, Beams
loadpanels = LoadPanels(
    LoadPanelNamePrefix="LP",
    Surfaces=[srf4pt, boundary],
    LoadPanelsLayer="LoadPanelsLayer",
    PanelType=2,
    TransferDirection=2,
    TransferMethod=1,
    Tolerance=0.001,
    RemDuplNodes=False,
    SwapOrientation=0,
    LCSangle=knob)  # -> Nodes, LoadPanels
cross_sections = Cross_Sections(Sections=sections)
surfaceload = SurfaceLoad(LoadCase="LC2", SurfList="LP1", CoordSys=0, Direction=2, LoadValue=-4)
panel = Panel(loadpanels.Nodes)
panel_2 = Panel(loadpanels.LoadPanels)
layers = Layers(LayerDefinition="LoadPanelsLayer;layer for surfaces;no")
koalaloadcases_groups = KoalaLoadCases(LoadCases="LC2; Permanent; LG1", LoadGroups="LG2; Variable; Standard")  # -> LoadCases, LoadGroups
panel_3 = Panel(layers)
createxml = CreateXML(
    StructureType=8,
    UILanguage=0,
    Materials="Concrete",
    MeshSize=0.15,
    Sections=cross_sections,
    Nodes=flatten([loadpanels.Nodes, beams.Nodes]),
    Beams=beams.Beams,
    Loadcases=koalaloadcases_groups.LoadCases,
    Loadgroups=koalaloadcases_groups.LoadGroups,
    Surfaceloads=surfaceload,
    FileName="C:/TEMP/LoadPanels.xml",
    Scale="1",
    RemDuplNodes=False,
    OnDemand=Button(),
    Edgeloads=edgeload,
    Layers=layers,
    Loadpanels=loadpanels.LoadPanels,
    Tolerance=0.001)
rec = DataRecorder(createxml, DataLimit=-10, RecordData=True)
panel_4 = Panel(rec)
# Syntax for sections:
# Name; Formcode; Reference; Material
# 
# Name: the name of the profile in SCIA Engineer: CS1, etc
# 
# Formcode:
# - steel profiles: FORM-X, where "X" is the formcode: https://help.scia.net/webhelplatest/en/#pvt/steelcodechecktb/annexes/annex_a_profile_library_formcodes.htm
# - concrete: CONC
# - timber: TIMB
# 
# Reference:
# - steel profiles: the naming needs to be identical with SCIA Engineer (eg: IPE200), and refer to an existing SCIA Engineer cross-section
# - concrete: the following  shapes are supported
# •	Rectangle CS1;CONC;RECTHxB;C20/25
# •	I section CS2;CONC;ISECHxBhxBsxtsxthxs;C20/25
# •	L section CS3;CONC;LSECHxBxthxsh;C20/25
# •	Reverse L section CS4;CONC;LREVHxBxthxsh;C20/25
# •	Circle CS5;CONC;CIRCD;C20/25
# •	Oval CS6;CONC;OVAL;HxB;C20/25
# 
# Material: the naming needs to be identical with a material in the SCIA Engineer project database (S 235 or C25/30 or...)
# 
# Note: there is a bug in SCIA Engineer 18.1 that will not update the formcode (required for proper steel code check) if the profile already exists in the project. Workaround: start with an empty profile list in your project, if you want to define them through Grasshopper.
internal_nodes = Panel("S1|NSp1;NSp2;NSp3")
