# Grasshopper definition NLcombination.gh (Grasshopper 1.0.7)
# plug-ins: Koala

load_groups = Panel("""LG1; Permanent
LG2; Variable; Standard""")
load_cases = Panel("""LC1; SW; LG1
LC2; Permanent; LG1
LC3; Variable; LG2""")
koalaloadcases_groups = KoalaLoadCases(LoadCases=load_cases, LoadGroups=load_groups)  # -> LoadCases, LoadGroups
nonlinearcombination = NonlinearCombination(Name="CO1", Type=0, CombinationInput="1.5*LC1;2*LC2", Description="Description")
panel = Panel(nonlinearcombination)
createxml = CreateXML(
    StructureType=8,
    UILanguage=0,
    Materials="Concrete",
    MeshSize=0.15,
    Loadcases=koalaloadcases_groups.LoadCases,
    Loadgroups=koalaloadcases_groups.LoadGroups,
    FileName="C:/TEMP/NL.xml",
    Scale="1",
    RemDuplNodes=False,
    OnDemand=Button(),
    NonLinCombinations=nonlinearcombination,
    Tolerance=0.001)
